# Grasshopper definition udp.gh (Grasshopper 0.9.76)
# plug-ins: Python Interpreter, gHowl

directorypath_with_backslashes_no_spaces = Panel("C:\Users\patri\Desktop\braid-evolution\unity\interactive-braid-evolution\Assets\Geometry\test")  # "DirectoryPath with Backslashes NO SPACES and FileName Minus Extension"

# ---- group: receive the message from Unity
ip_to_receive_on_this_computer = Panel("10.13.1.52")
port_to_receive_on = Panel("8051")
udp = UDPReceiver(Address=ip_to_receive_on_this_computer, Port=port_to_receive_on, Pattern=0)  # -> Info, Data
panel = Panel(udp.Info)

# ----
the_message_coming_from_unity = Panel(udp.Data)
brep = Brep([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])
c_script = CSharpScript(x=Slider(3, range=0..25), y=Slider(0, range=0..1), data=udp.Data)  # -> out, A; inputs x: Int32, y: Int32
# ---------- c_script: C# ----------
    string tmp = x.ToString() + ", " + y.ToString();
    A = "Messagge from Grasshopper: " + tmp;
# ---------- end c_script ----------
python_nik_s_obj_file_saver = PythonScript(FileNameToSave=directorypath_with_backslashes_no_spaces, Brep=brep)  # -> out; inputs Brep: list of Brep
# ---------- python_nik_s_obj_file_saver: Python ----------
import rhinoscriptsyntax
import Rhino

FILE_NAME = FileNameToSave

for q in range (0,len(Brep)):
  Rhino.RhinoDoc.ActiveDoc.Objects.AddBrep(Brep[q], Rhino.DocObjects.ObjectAttributes())

rhinoscriptsyntax.Command("SelAll")
rhinoscriptsyntax.Command("-Export " + FILE_NAME + ".obj y=n Enter Enter") #y=n turns off silly Y/Z axis swap! Use no spaces in the file path.
rhinoscriptsyntax.Command("Delete Enter")
# ---------- end python_nik_s_obj_file_saver ----------
ip_to_send_to = Panel("10.13.1.52")
port_to_send_to = Panel("8050")
the_message_being_sent_to_unity = Panel(c_script.A)
udp_2 = UDPSender(Address=ip_to_send_to, Port=port_to_send_to, Pattern=0, Data=c_script.A)
panel_2 = Panel(udp_2)
